vi "Function.gvi"   [LabVIEW Platform Developer Preview 0.1.0]
panel controls:
  "Trigger Send": bool
  "Trigger Reset": bool
panel indicators:
  "Send File": bool
  "Temp": f64[][]
  "Buffer": f64
  "Files Sent": f64
  "Available Memory": f64
  "Available Disk": f64
  "Reset": bool
uses:
  Component::Reset Aggregates.gvi
  Component::Read Tag (Double).gvi
  Component::Update Tag (Double).gvi
  Component::Build Array.gvi
diagram:
  w1 = "ni-crio-9068-190cb7b"  # Target
  w2 = "54.82.138.142"  # Server
  while {
    Wait(time to wait=50)
    case ($"Trigger Reset") {
      frame False, Default {
        $Reset <- FALSE
      }
      frame True {
        $Reset <- TRUE
        Concatenate Strings(w1, ".", "ai.0") -> w3
        call "Reset Aggregates.gvi"(Server=w2, Tag=w3)
        Wait(time to wait=500)
      }
    }
    case ($"Trigger Send") {
      frame False, Default {
        $"Send File" <- FALSE
      }
      frame True {
        $"Send File" <- TRUE
        Concatenate Strings(w1, ".", "send_file") -> w4
        call "Read Tag (Double).gvi"(Server=w2, Tag=w4) -> (Value=w5)
        Increment(x=w5) -> w6
        call "Update Tag (Double).gvi"(Server=w2, Tag=w4, Tag Value=w6)
        Wait(time to wait=500)
      }
    }
    stop if FALSE
  }
  while {
    Wait(time to wait=1000)
    w7 = ["available_disk", "available_memory", "files_sent", "buffer", "ai.0"]
    for (iteration -> i1) {
      w8 = each element of w7
      Concatenate Strings(w1, ".", w8) -> w9
      case (i1) {
        frame 0, Default {
          call "Read Tag (Double).gvi"(Server=w2, Tag=w9) -> (Value=w10)
          $"Available Disk" <- w10
        }
        frame 1 {
          call "Read Tag (Double).gvi"(Server=w2, Tag=w9) -> (Value=w11)
          $"Available Memory" <- w11
        }
        frame 2 {
          call "Read Tag (Double).gvi"(Server=w2, Tag=w9) -> (Value=w12)
          $"Files Sent" <- w12
        }
        frame 3 {
          call "Read Tag (Double).gvi"(Server=w2, Tag=w9) -> (Value=w13)
          $Buffer <- w13
        }
        frame 4 {
          call "Read Tag (Double).gvi"(Server=w2, Tag=w9) -> (Value=w14, Average=w15, Minimum=w16, Maximum=w17)
          call "Build Array.gvi"(Numeric=w14, Numeric_2=w15, Numeric_3=w16, Numeric_4=w17) -> (value=w18)
          $Temp <- w18
        }
      }
    }
    stop if FALSE
  }
