vi "Function_2.gvi"   [LabVIEW Platform Developer Preview 0.1.0]
panel indicators:
  "Value": f64
  "Timestamp": string
  "Count": f64
  "Average": f64
  "Minimum": f64
  "Maximum": f64
  "String": string
  "URI_2": string
types:
  T1 = cluster{"Timestamp": string, "Value": cluster{"Type": string, "Value": string}}
  T2 = cluster{"Sum": string, "Min": string, "Max": string, "Count": f64, "Avg": f64}
  T3 = cluster{"Path": string, "Current": T1, "Aggregates": T2}
diagram:
  w1 = "ni-crio-9068-190cb7b.ai.0"  # Target
  w2 = "54.82.138.142"  # Server
  Concatenate Strings("http://", w2, "/nitag/tag/", w1, "/values") -> w3
  call "WebVI_Get.gvi"(Url In=w3, Client Handle In=0, Output File In="", Time Out In=30000, Error Code In=0, Error Message In="") -> (Body Out=w4)
  $String <- w4
  w5 = T3 {all zero or empty}  # Cluster Constant
  Unflatten From JSON(JSON string=w4, default null elements=FALSE, enable LabVIEW extensions=TRUE, path=string[] [], strict validation=TRUE, type and defaults=w5) -> (value=w6)
  Property Node(instance in=w6) -> ("Current:Value:Value"=w7, "Current:Timestamp"=w8, "Aggregates:Min"=w9, "Aggregates:Max"=w10, "Aggregates:Count"=w11, "Aggregates:Avg"=w12)
  Scan From String(formatString="%f", inputString=w7) -> (out0=w13)
  $Value <- w13
  $Timestamp <- w8
  Scan From String(formatString="%f", inputString=w9) -> (out0=w14)
  $Minimum <- w14
  $URI_2 <- w3
  Scan From String(formatString="%f", inputString=w10) -> (out0=w15)
  $Maximum <- w15
  $Count <- w11
  $Average <- w12
