vi "Read Tag (Double).gvi"   [LabVIEW Platform Developer Preview 0.1.0]
inputs:
  "Server": string
  "Tag": string
outputs:
  "Value": f64
  "Timestamp": string
  "Count": f64
  "Average": f64
  "Minimum": f64
  "Maximum": f64
panel indicators:
  "URI": string
  "Response": string
types:
  T1 = cluster{"Timestamp": string, "Value": cluster{"Type": string, "Value": string}}
  T2 = cluster{"Sum": string, "Min": string, "Max": string, "Count": f64, "Avg": f64}
  T3 = cluster{"Path": string, "Current": T1, "Aggregates": T2}
diagram:
  Concatenate Strings("http://", $Server, "/nitag/tag/", $Tag, "/values") -> w1
  call "WebVI_Get.gvi"(Url In=w1, Client Handle In=0, Output File In="", Time Out In=30000, Error Code In=0, Error Message In="") -> (Body Out=w2)
  $Response <- w2
  w3 = T3 {all zero or empty}  # Cluster Constant
  Unflatten From JSON(JSON string=w2, default null elements=FALSE, enable LabVIEW extensions=TRUE, path=string[] [], strict validation=TRUE, type and defaults=w3) -> (value=w4)
  Property Node(instance in=w4) -> ("Current:Value:Value"=w5, "Current:Timestamp"=w6, "Aggregates:Min"=w7, "Aggregates:Max"=w8, "Aggregates:Count"=w9, "Aggregates:Avg"=w10)
  Scan From String(formatString="%f", inputString=w5) -> (out0=w11)
  $Value <- w11
  $Timestamp <- w6
  Scan From String(formatString="%f", inputString=w7) -> (out0=w12)
  $Minimum <- w12
  Scan From String(formatString="%f", inputString=w8) -> (out0=w13)
  $Maximum <- w13
  $Count <- w9
  $Average <- w10
  $URI <- w1
